# Grasshopper definition Iteration Component C#.gh (Grasshopper 1.0.7)
# plug-ins: HoopSnake

number_slider = Slider(0.25, range=0..1)
number_slider_2 = Slider(0.25, range=0..1)
radius = Slider(7.28, range=0.01..25)
bool = Boolean()
hs = HoopSnake(
    StartingData=Slider(0.25, range=0..1),
    Hoopsnake_Data_autoUpdate=False,
    Hoopsnake_Data_dataLimit=2147483647,
    Hoopsnake_Data_resetCounter=True,
    Hoopsnake_Data_updateView=True)  # -> Feedback, FeedbackHistory, LoopsCounter, IterationsCounter
cir = Circle(Plane=PlaneXY(0, 0, 0), Radius=radius)
c_script = CSharpScript(Slider=radius, Steps=Slider(1000, range=10..1000), Execute=Toggle(False))  # inputs Steps: Int32, Execute: Boolean
# ---------- c_script: C# ----------
    if (!Execute)
    {
      _step = 0;
      _steps = 0;
      _slider = null;
      return;
    }

    if (_slider == null)
    {
      _step = 0;
      _steps = Steps;
      _slider = Component.Params.Input[0].Sources[0] as Grasshopper.Kernel.Special.GH_NumberSlider;
      if (_slider == null)
        throw new InvalidCastException("Source of the Slider input is not a Slider");
    }

    if (_step <= _steps)
      GrasshopperDocument.ScheduleSolution(1, SolutionCallback);
# ---------- c_script: C# additional code ----------
  private int _step;
  private int _steps;
  private Grasshopper.Kernel.Special.GH_NumberSlider _slider;

  private void SolutionCallback(GH_Document document)
  {
    if (_slider == null)
      return;

    double percent = (double) _step / _steps;
    int tick = (int) (_slider.TickCount * percent);
    _slider.TickValue = tick;
    _slider.ExpireSolution(false);

    _step++;
    if (_step > _steps)
      return;
  }
# ---------- end c_script ----------
circle = Circle([{Plane=Plane(origin=(-2, 4, 0), x=(0.7071067812, -0.7071067812, 0), y=(0.7071067812, 0.7071067812, 0)), Radius=1.414213562}, {Plane=Plane(origin=(4, 3, 0), x=(-0.894427191, -0.4472135955, 0), y=(0.4472135955, -0.894427191, 0)), Radius=2.236067977}, {Plane=Plane(origin=(-2, -3, 0), x=(0, 1, 0), y=(-1, 0, 0)), Radius=1}, {Plane=Plane(origin=(2, -3, 0), x=(0.894427191, -0.4472135955, 0), y=(0.4472135955, 0.894427191, 0)), Radius=2.236067977}, {Plane=Plane(origin=(8, -3, 0), x=(-0.7071067812, 0.7071067812, 0), y=(-0.7071067812, -0.7071067812, 0)), Radius=1.414213562}, {Plane=Plane(origin=(16, 9, 0), x=(-0.7592566024, -0.6507913735, 0), y=(0.6507913735, -0.7592566024, 0)), Radius=9.219544457}, {Plane=Plane(origin=(-8, 8, 0), x=(0.8, -0.6, 0), y=(0.6, 0.8, 0)), Radius=10}])
c_script_2 = CSharpScript(x=Slider(0.25, range=0..1), y=bool)  # inputs Execute: Boolean
# ---------- c_script_2: C# usings ----------
using System.IO;
using System.Linq;
using System.Data;
using System.Drawing;
using System.Reflection;
using System.Windows.Forms;
using System.Xml;
using System.Xml.Linq;
using System.Runtime.InteropServices;

using Rhino.DocObjects;
using Rhino.Collections;
using GH_IO;
using GH_IO.Serialization;
# ---------- c_script_2: C# ----------
    if (!Execute)
    {
      _step = 0;
      _steps = 0;
      _slider = null;
      return;
    }

    if (_slider == null)
    {
      _step = 0;
      _steps = 1;
      _slider = Component.Params.Input[0].Sources[0] as Grasshopper.Kernel.Special.GH_NumberSlider;
      if (_slider == null)
        throw new InvalidCastException("Source of the Slider input is not a Slider");
    }

    if (_step <= _steps)
      GrasshopperDocument.ScheduleSolution(1, SolutionCallback);
# ---------- c_script_2: C# additional code ----------
  private int _step;
  private int _steps;
  private Grasshopper.Kernel.Special.GH_NumberSlider _slider;

  private void SolutionCallback(GH_Document document)
  {
    if (_slider == null)
      return;

    double percent = (double) _step / _steps;
    int tick = (int) (_slider.TickCount * percent);
    _slider.TickValue = tick;
    _slider.ExpireSolution(false);

    _step++;
    if (_step > _steps)
      return;
  }
# ---------- end c_script_2 ----------
ccx = CurveCurve(CurveA=circle, CurveB=cir)  # -> flatten(Points), ParamsA, ParamsB
rec = DataRecorder(ccx.Points, DataLimit=-10, RecordData=True)
