# Grasshopper definition Test_datacreator.gh (Grasshopper 0.9.80)

panel = Panel("""1
1
0
0
700.068059
4.217471
12572
79
699.79903
4.217471
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""")
panel_2 = Panel("""0
0
0.15
20
32
0
0
0.16
20
32
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""")
num = Number(17)
num_2 = Number(4)
num_3 = Number(16)
num_4 = Number(5)
matrix = ConstructMatrix(Rows=num, Columns=num_2, Values=panel)
matrix_2 = ConstructMatrix(Rows=num_3, Columns=num_4, Values=panel_2)
matrix_3 = DisplayMatrix(matrix)
matrix_4 = DisplayMatrix(matrix_2)
matrix_5 = Matrix()
matrix_6 = Matrix()
matrix_7 = Matrix()
panel_3 = Panel(matrix_7)
panel_4 = Panel(matrix_5)
matrix_8 = DisplayMatrix(matrix_7)
matrix_9 = DisplayMatrix(matrix_5)
panel_5 = Panel(matrix_6)
matrix_10 = DisplayMatrix(matrix_6)
