# Grasshopper definition test opt.gh (Grasshopper 0.9.80)

panel = Panel("""1
1
0
0
700.068059
4.217471
12572
79
699.79903
4.217471
13411
78
657.972911
4.386676
13331
75
704.79903
4.152471
13108
77""")
panel_2 = Panel("""0.15 
20 
32 
0.16 
20 
32 
0.15 
21 
32 
0.15 
20 
33""")
panel_3 = Panel("""0.05
0.32
14
29
28
37""")
num = Number(5)
num_2 = Number(4)
num_3 = Number(4)
num_4 = Number(3)
num_5 = Number(3)
num_6 = Number(2)
matrix = ConstructMatrix(Rows=num, Columns=num_2, Values=panel)
matrix_2 = ConstructMatrix(Rows=num_3, Columns=num_4, Values=panel_2)
matrix_3 = ConstructMatrix(Rows=num_5, Columns=num_6, Values=panel_3)
matrix_4 = DisplayMatrix(matrix)
matrix_5 = DisplayMatrix(matrix_2)
matrix_6 = DisplayMatrix(matrix_3)
matrix_7 = Matrix()
panel_4 = Panel(matrix_7)
matrix_8 = DisplayMatrix(matrix_7)
